# Grasshopper definition Basic_Extrusion_Command.gh (Grasshopper 1.0.7)
# plug-ins: Robots, Jellyfish, Flexibility

gripper_open = Brep([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])
construct_point = ConstructPoint(XCoordinate=Slider(1, range=0..1000), YCoordinate=Slider(155, range=0..1000), ZCoordinate=Slider(38, range=0..100))
brep_to_mesh = BrepToMesh(Brep=gripper_open, Density=2, MinimumEdgeLength=0.001)
xy_plane = XYPlane(Origin=construct_point)
mesh_join = MeshJoin(Meshes=brep_to_mesh)
yz_plane = YZPlane(Origin=Point(0, 0, 0))
g3meshautorepair = G3MeshAutoRepair(Mesh=mesh_join, RemoveMode=0, EdgeToTol=0.0002)
rotate = Rotate(Geometry=g3meshautorepair, Angle=1.570796327, Plane=yz_plane)  # -> Geometry, Transform
create_tool = CreateTool(Name="WASP_Extruder", TCP=xy_plane, Weight=Slider(1, range=0..10))  # -> Tool, TCP

list = FlagFields({"Shoulder": 1, "Elbow": 2, "Wrist": 4}, selected="Wrist")
list_2 = ValueList({"Joint", "Linear"}, selected="Linear")
zone_parameter = ZoneParameter(Slider(0.1, range=0..100))
speed_parameter = SpeedParameter(Slider(100, range=0..1000))

point = Point(Point(-477.3731617, -309.2530861, 394.3582116))
point_2 = Point(Point(99.51099981, -45.77480171, 394.3582116))
curve = Curve(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)
list_3 = RobotsLibrary(
    {"CITA-IRB1600-145 + Turntable", "CITA-IRB1600-145 + IRB140", "CITA-IRB1600-145", "CITA-IRB140", "CITA-UR5e", "iaac-KR150-2_110", "iaac-IRB140", "iaac-IRB120", "Penn State IRB120", "Penn State IRB2400-16", "Taiwan-IRB1600", "Taiwan-KR6", "Taiwan-KR10", "TUDelft-LAMA-UR5", "UR3e", "UR5e", "UR10e", "UR16e", "UR3", "UR5", "UR10"}, selected="UR10e",
    Type=0)
divdist = DivideDistance(Curve=curve, Distance=Slider(1, range=0..100))  # -> simplify(Points), Tangents, Parameters
point_3 = Point(Point(0, -700, 0))
analog_signal_in_volts = Slider(3.45, range=0..5)
setup = Brep([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])
xz_plane = XZPlane(Origin=point)
load_robot_system = LoadRobotSystem(Name=list_3, Base=point_3)
custom_preview = CustomPreview(
    Geometry=setup,
    Material={diffuse=RGB(198, 222, 160), emission=RGB(59, 67, 48), shine=0.5, specular=RGB(255, 255, 255), transparency=0})
xz_plane_2 = XZPlane(Origin=point_2)
rotate_plane = RotatePlane(Plane=xz_plane, Angle=degrees(Slider(270, range=-360..360)))
rotate_plane_2 = RotatePlane(Plane=xz_plane_2, Angle=degrees(Slider(270, range=-360..360)))
remap_numbers = RemapNumbers(Value=analog_signal_in_volts, Source=Domain(0, 5), Target=Domain(0, 0.5))  # -> Mapped, Clipped
flip_plane = FlipPlane(Plane=rotate_plane, ReverseX=False, ReverseY=False, SwapAxes=True)
set_ao = SetAO(AO=0, Value=remap_numbers.Mapped)
flip_plane_2 = FlipPlane(Plane=rotate_plane_2, ReverseX=False, ReverseY=False, SwapAxes=True)
panel = Panel("popup(\"Press CONTINUE to start the program\",\"StartConfirmation\",warning=False,error=False, blocking=True)")
create_target = CreateTarget(
    Plane=flip_plane,
    RobConf=list,
    Motion=list_2,
    Tool=create_tool.Tool,
    Speed=speed_parameter,
    Zone=zone_parameter,
    IsCartesian=True)
create_target_2 = CreateTarget(
    Plane=flip_plane_2,
    RobConf=list,
    Motion=list_2,
    Tool=create_tool.Tool,
    Speed=speed_parameter,
    Zone=zone_parameter,
    Command=set_ao,
    IsCartesian=True)
merge = Merge(Data1=create_target, Data2=create_target_2)
customcmd = CustomCommand(Name="CustomCommand", Manufacturer="UR", Code=panel)
create_program = CreateProgram(Name="Extrusion_Signal", RobotSystem=load_robot_system, Targets=merge, InitCommands=customcmd, StepSize=1)  # -> Program, Code, Duration, Warnings, Errors
program_simulation = ProgramSimulation(Program=create_program.Program, Time=Slider(1, range=0..1), Normalized=True)  # -> SystemMeshes, JointRotations, Plane, Index, Time, Program, Errors
start = Button()
pause = Button()
play = Button()
panel_2 = Panel("sftp://169.254.186.139")
custom_preview_2 = CustomPreview(
    Geometry=program_simulation.SystemMeshes,
    Material={diffuse=RGB(221, 160, 221), emission=RGB(66, 48, 66), shine=0.5, specular=RGB(255, 255, 255), transparency=0})
remote = RemoteConnection(Program=create_program.Program, IP="169.254.186.139", Upload=start, Play=play, Pause=pause)
